# Grasshopper definition Spin rotation.gh (Grasshopper 1.0.7)
# plug-ins: Bifocals, Kangaroo2 Components

strength = Slider(0.3, range=0..1)
boundary = Slider(45, range=30..50)
radius = Slider(4.7, range=0..10)
count = Slider(38, range=0..50)
expand = Slider(3.5, range=3..7)
decay = Slider(1.2, range=1..2)
gap = Slider(10, range=5..20)
boundary_2 = GetNumber(boundary, AtLeast=1, AtMost=1, Maximum=1.797693135e+308, Minimum=-1.797693135e+308)
decay_2 = GetNumber(decay, AtLeast=1, AtMost=1, Maximum=1.797693135e+308, Minimum=-1.797693135e+308)
expand_2 = GetNumber(expand, AtLeast=1, AtMost=1, Maximum=1.797693135e+308, Minimum=-1.797693135e+308)
gap_2 = GetNumber(gap, AtLeast=1, AtMost=1, Maximum=1.797693135e+308, Minimum=-1.797693135e+308)
radius_2 = GetNumber(radius, AtLeast=1, AtMost=1, Maximum=1.797693135e+308, Minimum=-1.797693135e+308)
strength_2 = GetNumber(strength, AtLeast=1, AtMost=1, Maximum=1.797693135e+308, Minimum=-1.797693135e+308)
count_2 = GetNumber(count, AtLeast=1, AtMost=1, Maximum=1.797693135e+308, Minimum=-1.797693135e+308)
negative = Negative(Value=boundary_2)
construct_domain = ConstructDomain(DomainStart=boundary_2, DomainEnd=negative)
circle = Circle(Plane=PlaneXY(0, 0, 0), Radius=gap_2)
divide_curve = DivideCurve(Curve=circle, Count=Slider(2, range=0..10), Kinks=False)  # -> Points, Tangents, Parameters
rectangle = Rectangle(Plane=PlaneXY(0, 0, 0), XSize=construct_domain, YSize=construct_domain, Radius=0)  # -> Rectangle, Length
spin_force = SpinForce(Plane=divide_curve.Points, Strength=strength_2, Radius=expand_2, Decay=decay_2, Bounds=rectangle.Rectangle)
point_charge = PointCharge(Point=divide_curve.Points, Charge=Slider(0.4, range=0..1), Decay=Slider(1.5, range=0..10), Bounds=rectangle.Rectangle)
circle_2 = Circle(Plane=divide_curve.Points, Radius=radius_2)
merge_fields = MergeFields(Fields=[point_charge, spin_force])
divide_curve_2 = DivideCurve(Curve=circle_2, Count=count_2, Kinks=False)  # -> Points, Tangents, Parameters
boundary_surfaces = BoundarySurfaces(Edges=rectangle.Rectangle)
negative_2 = Negative(Value=Slider(1, range=0..1))
field_line = FieldLine(Field=merge_fields, Point=divide_curve_2.Points, Steps=1000, Accuracy=0.1, Method=3)
unit_z = UnitZ(Factor=negative_2)
extrude = Extrude(Base=boundary_surfaces, Direction=unit_z)
divide_curve_3 = DivideCurve(Curve=field_line, Count=10, Kinks=False)  # -> Points, Tangents, Parameters
nurbs_curve = NurbsCurve(Vertices=divide_curve_3.Points, Degree=3, Periodic=False)  # -> Curve, Length, Domain
point_on_curve = PointOnCurve(nurbs_curve.Curve, parameter=0.507)
pull_point = PullPoint(Point=divide_curve_3.Points, Geometry=point_on_curve, ClosestOnly=True)  # -> ClosestPoint, Distance
graph_mapper = GraphMapper(
    pull_point.Distance,
    x0=0,
    x1=25,
    y0=0,
    y1=25,
    container_name="Bezier",
    cpx=[0, 0.2572109997, 0.4285906255, 1],
    cpy=[0.1328293085, 0.1718515754, 0, 0])
unit_z_2 = UnitZ(Factor=graph_mapper)
move = Move(Geometry=divide_curve_3.Points, Motion=unit_z_2)  # -> Geometry, Transform
nurbs_curve_2 = NurbsCurve(Vertices=move.Geometry, Degree=3, Periodic=False)  # -> Curve, Length, Domain
loft = Loft(
    Curves=[nurbs_curve.Curve, nurbs_curve_2.Curve],
    Options={Adjust=False, Closed=False, LoftEnds=0, LoftSimp=0, LoftType=0, Rebuild=10, Refit=0.01})
mesh = Mesh(loft)
clean = CombineClean(Meshes=mesh)
medges = MeshEdges(Mesh=clean)  # -> NakedEdges, InteriorEdges, NonManifoldEdges
join = JoinCurves(Curves=medges.NakedEdges, Preserve=medges.NakedEdges)
join_2 = JoinCurves(Curves=medges.InteriorEdges, Preserve=False)
merge = Merge(Data1=join, Data2=join_2, Data3=extrude)  # -> flatten(Result)
curvepoint = PointOnCurve(merge, parameter=0.5)
pt = ConstructPoint(XCoordinate=0, YCoordinate=0, ZCoordinate=0)
pull = PullPoint(Point=curvepoint, Geometry=pt, ClosestOnly=True)  # -> ClosestPoint, Distance
bnd = Bounds(Numbers=pull.Distance)
remap = RemapNumbers(Value=pull.Distance, Source=bnd, Target=Domain(0, 1))  # -> Mapped, Clipped
gradient = Gradient(
    LowerLimit=0,
    UpperLimit=1,
    Parameter=remap.Mapped,
    stops=[0: RGB(243, 57, 0), 0.1: RGB(236, 27, 60), 0.2: RGB(210, 0, 118), 0.3: RGB(103, 0, 120), 0.4: RGB(39, 72, 161), 0.5: RGB(1, 192, 229), 0.6: RGB(18, 178, 90), 0.7: RGB(79, 186, 8), 0.8: RGB(220, 237, 32), 0.9: RGB(247, 159, 20), 1: RGB(243, 57, 0)])
c_script = CSharpScript(crv=nurbs_curve.Curve, color=gradient)  # -> out, A; inputs crv: Curve, color: Color
# ---------- c_script: C# ----------
    var c = color.R + "," + color.G + "," + color.B;
    crv.SetUserString("color", c);
    A = crv;
# ---------- end c_script ----------

# ---- group: RH_OUT:edges
curve = Curve(flatten(c_script.A))

# ----
custom_preview = CustomPreview(Geometry=curve, Material=ColourSwatch(SwatchColor=RGB(176, 84, 84)))
context_bake = ContextBake(Geometry=curve)
